# Grasshopper definition portland_dwelling_units.gh (Grasshopper 1.0.7)
# plug-ins: ElkGHComponents

path = FilePath("C:\Users\jonah.hawk\Dropbox\Dev\Python\PyCharm\OSM_Data\portland_dwelling_units.osm")
loc = Location(FilePathText=path)  # -> OSMPointData, OSMFile, LongitudeDomain, LatitudeDomain
bldg = OSMData(OSMPointData=loc.OSMPointData, OSMFilePath=loc.OSMFile, Feature="building", Generate3d=True, IndividualOutputs=False)  # -> Ways, Buildings, FeatureKey
brep = Brep(bldg.Buildings)
tmatch = MatchText(Text=bldg.FeatureKey, RegEx="dwelling_units", Case=True)
cull = CullPattern(List=bldg.FeatureKey, CullPattern=tmatch)
ma = MassAddition(Input=tmatch)  # -> Result, PartialResults
pline = PolyLine(Vertices=bldg.Ways, Closed=True)
cull_2 = CullPattern(List=brep, CullPattern=ma.Result)
split = TextSplit(Text=cull, Separators=":")
bbox = BoundingBox(Content=cull_2, Plane=PlaneXY(0, 0, 0))  # -> Box, Box_2
item = ListItem(List=split, Index=0, Wrap=True)  # -> Item, Item1
box = EvaluateBox(Box=bbox.Box, UParameter=0.5, VParameter=0.5, WParameter=1)  # -> Plane, Point, Include
Z = UnitZ(Factor=Slider(30, range=6..50))
move = Move(Geometry=box.Point, Motion=Z)  # -> Geometry, Transform
xz = XZPlane(Origin=move.Geometry)
panel = Panel(split)
tag = TextTag3D(
    Location=xz,
    Text=item.Item1,
    Size=Slider(43, range=0..100),
    Colour=ColourSwatch(SwatchColor=RGB(255, 0, 0)),
    Justification=5)
panel_2 = Panel(ma.Result)
